# Dynamo graph Nodes.dyn (Dynamo 2.13.1.3887)

code_block = CodeBlock { "Hello world!"; }
createTextBox = Controls.Input.CreateTextBox(text=code_block)
categories = Categories("OST_Levels")
all_elements_of_category = ElementsOfCategory(Category=categories)
code_block_2 = CodeBlock { "Name"; }
createComboBox = Controls.Selection.CreateComboBox(list=all_elements_of_category, displayProp=code_block_2)
code_block_3 = CodeBlock { "OK"; }
createButtonOk = Controls.Buttons.CreateButtonOk(text=code_block_3)
list_create = List.Create(item0=createTextBox, item1=createComboBox, item2=createButtonOk)
code_block_4 = CodeBlock { [1]; [1, 8, 1]; }
code_block_5 = CodeBlock { [0]; [0, 1, 2]; }
createGrid = Controls.Layout.CreateGrid(content=list_create, columnDefinitions=code_block_4.out0, rowDefinitions=code_block_4.out1, elementColumn=code_block_5.out0, elementRow=code_block_5.out1)
code_block_6 = CodeBlock { 420; 840; }
code_block_7 = CodeBlock { "DynaDesign"; }
dynaDesignWindow = DynaDesign.Windows.DynaDesignWindow(grid=createGrid, height=code_block_6.out0, width=code_block_6.out1, title=code_block_7)
watch = Watch(dynaDesignWindow)
